# Dynamo graph Patcher.dyn "placing patch" (Dynamo 2.2.1.5175)

# group: Input
length_d_of_column = LengthFromString(Value=0.035024314)
select_model_elements = DSModelElementsSelection()  # 5 picked in the model; graph input
direction_x_or_y = BoolSelector(false)  # graph input
direction_or = BoolSelector(false)  # graph input
family_types_of_patch = FamilyTypes("Patch:Default")  # graph input
direction_flip_or_not = BoolSelector(false)  # graph input

getCategory = Element.GetCategory(element=select_model_elements)
name = Category.Name(category=getCategory)
code_block = CodeBlock { "Structural Framing"; "Structural Columns"; }
eq = name == code_block.out1
filterByBoolMask = List.FilterByBoolMask(list=select_model_elements, mask=eq)
getLocation = Element.GetLocation(element=filterByBoolMask.in)
X = Point.X(point=getLocation)
Y = Point.Y(point=getLocation)
eq_2 = name == code_block.out0
filterByBoolMask_2 = List.FilterByBoolMask(list=select_model_elements, mask=eq_2)
getLocation_2 = Element.GetLocation(element=filterByBoolMask_2.in)
startPoint = Curve.StartPoint(curve=getLocation_2)
code_block_2 = CodeBlock { 0; }
getItemAtIndex = List.GetItemAtIndex(list=startPoint, index=code_block_2)
Z = Point.Z(point=getItemAtIndex)
byCoordinates = Point.ByCoordinates(x=X, y=Y, z=Z)
elementType = Element.ElementType(element=filterByBoolMask.in)
code_block_3 = CodeBlock { "D"; }
parameterByName = Parameter.ParameterByName(element=elementType, name=code_block_3)
value = Parameter.Value(parameter=parameterByName)
code_block_4 = CodeBlock { 0; }
getItemAtIndex_2 = List.GetItemAtIndex(list=value, index=code_block_4)
python_script = Python(IN[0]=direction_x_or_y, IN[1]=direction_or, IN[2]=X, IN[3]=Y, IN[4]=getItemAtIndex_2, IN[5]=Z)
# ---------- python_script.python (28 lines) ----------
# 加载 Python Standard 和 DesignScript 库
import sys
import clr
clr.AddReference('ProtoGeometry')
from Autodesk.DesignScript.Geometry import *

# 该节点的输入内容将存储为 IN 变量中的一个列表。
dataEnteringNode = IN

# 将代码放在该行下面
z=IN[5]
sub_points=[]
if IN[1]:
	wid=IN[4]
else:
	wid=-IN[4]
for i in range(len(IN[2])):	
	if IN[0]:
		x=IN[2][i]+wid
		y=IN[3][i]
	else:
		x=IN[2][i]
		y=IN[3][i]+wid
	sub_points.Add(Point.ByCoordinates(x, y, z))
	

# 将输出内容指定给 OUT 变量。
OUT = sub_points
# ----------------------------------------
byStartPointEndPoint = Line.ByStartPointEndPoint(startPoint=byCoordinates, endPoint=python_script)
code_block_5 = CodeBlock { 0; }
getItemAtIndex_3 = List.GetItemAtIndex(list=byStartPointEndPoint, index=code_block_5)
code_block_6 = CodeBlock { "D"; }
parameterByName_2 = Parameter.ParameterByName(element=family_types_of_patch, name=code_block_6)
value_2 = Parameter.Value(parameter=parameterByName_2)
python_script_2 = Python(IN[0]=direction_flip_or_not, IN[1]=Z, IN[2]=value_2)
# ---------- python_script_2.python (16 lines) ----------
# Load the Python Standard and DesignScript Libraries
import sys
import clr
clr.AddReference('ProtoGeometry')
from Autodesk.DesignScript.Geometry import *

# The inputs to this node will be stored as a list in the IN variables.
dataEnteringNode = IN

# Place your code below this line
if IN[0]:
	OUT=IN[1]+IN[2]
else:
	OUT=IN[1]

# Assign your output to the OUT variable.
# ----------------------------------------
byElevation = Level.ByElevation(elevation=python_script_2)
byCurve = Custom[FamilyInstance.ByCurve](curve=getItemAtIndex_3, familyType=family_types_of_patch, level=byElevation)  # Places a line-based family instance on a given level
